# Dynamo graph IsInsideParcel.dyn (Dynamo 2.5.2.7915)
# packages: Civil3DToolkit 1.0.17, AMR_CivilDynNodes 1.1.52

# group: Civil 3D Toolkit
current = Autodesk.AutoCAD.DynamoNodes.Document.Current()
getSites = Autodesk.Civil.DynamoNodes.LandDevelopment.Site.GetSites(document=current)
getParcels = Autodesk.Civil.DynamoNodes.LandDevelopment.Site.GetParcels(site=getSites)
area = Autodesk.Civil.DynamoNodes.LandDevelopment.Parcel.Area(parcel=getParcels)

code_block = CodeBlock { 0; "Standard : 4"; }
byIndex = CivilDynamoTools.Site.ByIndex(index=code_block.out0)
byName = CivilDynamoTools.Parcel.ByName(siteObject=byIndex, parcelName=code_block.out1)
polyCurves = CivilDynamoTools.Parcel.PolyCurves(parcel=byName)
firstItem = List.FirstItem(list=polyCurves)
color_palette = ColorPalette({R: 255, G: 0, B: 0, A: 255})
byGeometryColor = Modifiers.GeometryColor.ByGeometryColor(geometry=firstItem, color=color_palette)
lastItem = List.LastItem(list=polyCurves)
color_palette_2 = ColorPalette({R: 139, G: 69, B: 19, A: 255})
byGeometryColor_2 = Modifiers.GeometryColor.ByGeometryColor(geometry=lastItem, color=color_palette_2)
select_object = ObjectSelection()  # 1 picked in the model
convertDynamoPolylineToPolyCurve = CivilDynamoTools.Parcel.ConvertDynamoPolylineToPolyCurve(dynamoPolyline=select_object)
isInsideParcel = Custom[IsInsideParcel](polyCurveToTest=convertDynamoPolylineToPolyCurve, enclosingPolyCurve=firstItem)
