# Dynamo graph Testing SSM Nodes.dyn (Dynamo 2.5.2.7915)

code_block = CodeBlock { "E:\\Programming\\Testing2.dst"; }
code_block_2 = CodeBlock { false; }
openSheetSet = CivilDynamoTools.SheetSetMgr.OpenSheetSet(dstPath=code_block, failIfOpen=code_block_2)
sheetSetName = CivilDynamoTools.SheetSetMgr.SheetSetName(sheetSet=openSheetSet)
sheetSetDesc = CivilDynamoTools.SheetSetMgr.SheetSetDesc(sheetSet=openSheetSet)
fileName = CivilDynamoTools.SheetSetMgr.FileName(sheetSet=openSheetSet)
getSheets = CivilDynamoTools.SheetSetMgr.GetSheets(sheetSet=openSheetSet)
getSheetName = CivilDynamoTools.SheetSetMgr.GetSheetName(sheet=getSheets)
