# Dynamo graph testing areas.dyn (Dynamo 2.5.2.7915)

getSites = CivilDynamoTools.Sites.GetSites()
getParcels = CivilDynamoTools.Sites.GetParcels(site=getSites)
baseCurve2d = CivilDynamoTools.Parcels.BaseCurve2d(parcel=getParcels@L1)
getPolylineVertices = CivilDynamoTools.Parcels.GetPolylineVertices(polyline=baseCurve2d)
areaByCoordinates = CivilDynamoTools.Parcels.AreaByCoordinates()  # unwired: points
