# Dynamo graph testing parcels.dyn (Dynamo 2.5.2.7915)
# packages: Civil3DToolkit 1.0.17

getSites = CivilDynamoTools.Sites.GetSites()
getParcels = CivilDynamoTools.Sites.GetParcels(site=getSites)
getName = CivilDynamoTools.Parcel.GetName(parcel=getParcels)
select_object = ObjectSelection()  # 1 picked in the model
select_object_2 = ObjectSelection()  # 1 picked in the model
list_create = List.Create(item0=select_object, item1=select_object_2)
geometry = Autodesk.AutoCAD.DynamoNodes.Object.Geometry(object=list_create)
pointsFromPolyCurve = CivilDynamoTools.Parcels.PointsFromPolyCurve(polycurve=geometry)

# group: Civil 3D Toolkit
current = Autodesk.AutoCAD.DynamoNodes.Document.Current()
getSites_2 = Autodesk.Civil.DynamoNodes.LandDevelopment.Site.GetSites(document=current)
getParcels_2 = Autodesk.Civil.DynamoNodes.LandDevelopment.Site.GetParcels(site=getSites_2)
area = Autodesk.Civil.DynamoNodes.LandDevelopment.Parcel.Area(parcel=getParcels_2)

code_block = CodeBlock { 1; -2; }
flatten = List.Flatten(list=getParcels, amt=code_block.out0)
dropItems = List.DropItems(list=flatten, amount=code_block.out0)
dropItems_2 = List.DropItems(list=dropItems, amount=code_block.out1)
getArea = CivilDynamoTools.Parcel.GetArea(parcel=dropItems_2)
polyCurveByParcel = CivilDynamoTools.Parcel.PolyCurveByParcel(parcel=getParcels)
pointsFromPolyCurve_2 = CivilDynamoTools.Parcel.PointsFromPolyCurve(polycurve=polyCurveByParcel)
areaByCoordinates = CivilDynamoTools.Parcel.AreaByCoordinates(points=pointsFromPolyCurve_2)
select_object_3 = ObjectSelection()  # 1 picked in the model
geometry_2 = Autodesk.AutoCAD.DynamoNodes.Object.Geometry(object=select_object_3)
pointsFromPolyCurve_3 = CivilDynamoTools.Parcel.PointsFromPolyCurve(polycurve=geometry_2)
areaByCoordinates_2 = CivilDynamoTools.Parcel.AreaByCoordinates(points=pointsFromPolyCurve_3)
